vi "index.gviweb"   [G Web Development Software 22.3.0]
panel controls:
  "Usuario": string
  "Contraseña": string
  "Confirm Button": bool
  "Logo3G_Image": string = "Image/LOGO%202024%20V3%20205X50.png"
  "LogoEecol_Image": string = "Image/EECOL%20LOGO%20156X50.png"
  "LogoLF_Image": string = "Image/LITELLFUSE%20201X50.png"
  "LogoPHOC_Image": string = "Image/PHOENIX%20CONTACT%20LOGO%20196X50.png"
  "Logo3G_Image_2": string = "Image/LOGO%202024%20V3%20205X50.png"
  "LogoEecol_Image_2": string = "Image/EECOL%20LOGO%20156X50.png"
  "LogoLF_Image_2": string = "Image/LITELLFUSE%20201X50.png"
  "LogoPHOC_Image_2": string = "Image/PHOENIX%20CONTACT%20LOGO%20196X50.png"
  "Logo3G_Image_3": string = "Image/LOGO%202024%20V3%20205X50.png"
  "LogoEecol_Image_3": string = "Image/EECOL%20LOGO%20156X50.png"
  "LogoLF_Image_3": string = "Image/LITELLFUSE%20201X50.png"
  "LogoPHOC_Image_3": string = "Image/PHOENIX%20CONTACT%20LOGO%20196X50.png"
  "Panel_Image_2": string = "Image/CDC%20ABB%2001%20450X290.png"
  "LogoEecol_Image_4": string = "Image/EECOL%20LOGO%20156X50.png"
  "SmartPhone": bool
  "LogoEecol_Image_5": string = "Image/EECOL%20LOGO%20156X50.png"
  "Tab_2": i32
  "Logo3G_Image_4": string = "Image/LOGO%202024%20V3%20205X50.png"
  "Logo3G_Image_5": string = "Image/LOGO%202024%20V3%20205X50.png"
panel indicators:
  "body": string
  "Tab": i32
  "Light on Sensor 1 Max": cluster{"Element 1": f64, "Element 2": f64}
  "SENSOR 1": bool
  "SENSOR 3": bool
  "TRIP 1": bool
  "TRIP 2": bool
  "PROTECTION ACTIVE": bool
  "TRIPPED": bool
  "Light on Sensor 3 Max": cluster{"Element 1": f64, "Element 2": f64}
  "S1 LoS Max": f64
  "S3 LoS Max": f64
  "S1 Lux Max": f64
  "S3 Lux Max": f64
  "URL Image": string
  "URL Image_2": string
  "URL Image_4": string
  "SENSOR 1_2": bool
  "SENSOR 3_2": bool
  "TRIP 1_2": bool
  "TRIP 2_2": bool
  "PROTECTION ACTIVE_2": bool
  "TRIPPED_2": bool
  "S1 LoS Max_2": f64
  "S3 LoS Max_2": f64
  "Light on Sensor 1 Max_2": cluster{"Element 1": f64, "Element 2": f64}
  "Light on Sensor 3 Max_2": cluster{"Element 1": f64, "Element 2": f64}
  "body_2": string
  "CDC_ABB": string
  "URL Image_3": string
  "URL Image_5": string
  "URL Image_6": string
  "URL Image_7": string
  "S1 LoS Max_3": f64
  "S3 LoS Max_3": f64
types:
  T1 = cluster{"S1max": f64, "S1": bool, "S3max": f64, "S3": bool, "PActive": bool, "Tripped": bool, "Trip1": bool, "Trip2": bool}
uses:
  NI::HTTP::Open HTTP Handle.gvi
  NI::HTTP::GET.gvi
  NI::HTTP::Close HTTP Handle.gvi
  NI::HTTP::PUT Buffer.gvi
diagram:
  disable {
    frame Enabled { }
    frame Disabled { }
  }
  sequence {
    frame 0 {
      Property Node(instance in=reference to "Usuario", "Value"="")
      Property Node(instance in=reference to "Contraseña", "Value"="")
      Property Node(instance in=reference to unnamed text, "Visible"=FALSE)
      $Tab <- 0
    }
  }
  call "Open HTTP Handle.gvi"(error in=no error) -> (client handle out=w1, error out=w2)
  s1 = w2  # shift register
  s2 = w1  # shift register
  while {
    Wait(time to wait=250)
    w3 = cluster{"user": string, "password": string} {all zero or empty}
    w4 = "https://arc-flash-relay-default-rtdb.firebaseio.com/access.json"
    call "GET.gvi"(client handle=s2, url=w4, error in=s1) -> (client handle out=w5, body=w6, error out=w7)
    Unflatten From Json(JSON string=w6, type and defaults=w3) -> (value=w8)
    case ($"Confirm Button") {
      frame False, Default {
        w9 = FALSE
        w10 = FALSE
      }
      frame True {
        Property Node(instance in=w8) -> ("user"=w11, "password"=w12)
        Is Equal(x=$Usuario, y=w11) -> w13
        Is Equal(x=w12, y=$Contraseña) -> w14
        Logical And(w13, w14) -> w9
        case (w9) {
          frame True {
            Property Node(instance in=reference to unnamed text, "Visible"=FALSE)
          }
          frame False {
            Property Node(instance in=reference to unnamed text, "Visible"=TRUE)
          }
        }
        w10 = $SmartPhone
      }
    }
    next s1 = w7
    next s2 = w5
    stop if w9
  }
  case (FALSE) {
    frame True, Default {
      call "Close HTTP Handle.gvi"(client handle=s2, error in=s1)
    }
    frame False {
      s3 = s2  # shift register
      s4 = s1  # shift register
      while {
        Wait(time to wait=50)
        disable {
          frame Enabled {
            w15 = s4
            w16 = s3
          }
          frame Disabled {
            w17 = "https://arc-flash-relay-default-rtdb.firebaseio.com/data-read.json"
            Property Node(instance in=cluster{"Reset": bool} {all zero or empty}) -> (instance out=w18)
            Flatten To Json(anything=w18) -> (JSON string=w19)
            call "PUT Buffer.gvi"(client handle=s3, url=w17, buffer=w19, error in=s4) -> (client handle out=w16, error out=w15)
          }
        }
        w20 = "https://arc-flash-relay-default-rtdb.firebaseio.com/data-send.json"
        call "GET.gvi"(client handle=w16, url=w20, error in=w15) -> (client handle out=w21, body=w22, error out=w23)
        $body <- w22
        Unflatten From Json(JSON string=w22, type and defaults=T1 {all zero or empty}) -> (value=w24)
        Property Node(instance in=w24) -> ("S1max"=w25, "S1"=w26, "S3max"=w27, "S3"=w28, "PActive"=w29, "Tripped"=w30, "Trip1"=w31, "Trip2"=w32)
        $"SENSOR 1" <- w26
        $"SENSOR 3" <- w28
        $"PROTECTION ACTIVE" <- w29
        case (w10) {
          frame False, Default {
            w33 = 1
          }
          frame True {
            w33 = 2
          }
        }
        $Tab <- w33
        $TRIPPED <- w30
        $"S1 Lux Max" <- w25
        $"S1 LoS Max" <- w25
        $"S3 Lux Max" <- w27
        $"S3 LoS Max" <- w27
        $"TRIP 1" <- w31
        $"TRIP 2" <- w32
        Build Cluster(w25, 13000) -> w34
        $"Light on Sensor 1 Max" <- w34
        Build Cluster(w27, 13000) -> w35
        $"Light on Sensor 3 Max" <- w35
        $"Light on Sensor 1 Max_2" <- w34
        $"Light on Sensor 3 Max_2" <- w35
        $"SENSOR 1_2" <- w26
        $"SENSOR 3_2" <- w28
        $"PROTECTION ACTIVE_2" <- w29
        $TRIPPED_2 <- w30
        $"S1 LoS Max_2" <- w25
        $"S3 LoS Max_2" <- w27
        $"TRIP 1_2" <- w31
        $"TRIP 2_2" <- w32
        next s3 = w21
        next s4 = w23
        stop if FALSE
      }
      call "Close HTTP Handle.gvi"(client handle=s3, error in=s4)
    }
  }
