vi "index2.gviweb"   [G Web Development Software 22.3.0]
panel controls:
  "Logo3G_Image_3": string = "Image/LOGO%202024%20V3%20205X50.png"
  "LogoEecol_Image_3": string = "Image/EECOL%20LOGO%20156X50.png"
  "LogoLF_Image_3": string = "Image/LITELLFUSE%20201X50.png"
  "LogoPHOC_Image_3": string = "Image/PHOENIX%20CONTACT%20LOGO%20196X50.png"
  "Panel_Image_2": string = "Image/CDC%20ABB%2001%20450X290.png"
panel indicators:
  "Tab": i32
  "URL Image_4": string
  "SENSOR 1_2": bool
  "SENSOR 3_2": bool
  "TRIP 1_2": bool
  "TRIP 2_2": bool
  "PROTECTION ACTIVE_2": bool
  "TRIPPED_2": bool
  "S1 LoS Max_2": f64
  "S3 LoS Max_2": f64
  "Light on Sensor 1 Max_2": cluster{"Element 1": f64, "Element 2": f64}
  "Light on Sensor 3 Max_2": cluster{"Element 1": f64, "Element 2": f64}
  "body_2": string
types:
  T1 = cluster{"S1max": f64, "S1": bool, "S3max": f64, "S3": bool, "PActive": bool, "Tripped": bool, "Trip1": bool, "Trip2": bool}
uses:
  NI::HTTP::Open HTTP Handle.gvi
  NI::HTTP::PUT Buffer.gvi
  NI::HTTP::GET.gvi
  NI::HTTP::Close HTTP Handle.gvi
diagram:
  disable {
    frame Enabled { }
    frame Disabled { }
  }
  sequence {
    frame 0 {
      $Tab <- 0
    }
  }
  call "Open HTTP Handle.gvi"(error in=no error) -> (client handle out=w1, error out=w2)
  s1 = w1  # shift register
  s2 = w2  # shift register
  while {
    Wait(time to wait=50)
    disable {
      frame Enabled {
        w3 = s2
        w4 = s1
      }
      frame Disabled {
        w5 = "https://arc-flash-relay-default-rtdb.firebaseio.com/data-read.json"
        Property Node(instance in=cluster{"Reset": bool} {all zero or empty}) -> (instance out=w6)
        Flatten To Json(anything=w6) -> (JSON string=w7)
        call "PUT Buffer.gvi"(client handle=s1, url=w5, buffer=w7, error in=s2) -> (client handle out=w4, error out=w3)
      }
    }
    w8 = "https://arc-flash-relay-default-rtdb.firebaseio.com/data-send.json"
    call "GET.gvi"(client handle=w4, url=w8, error in=w3) -> (client handle out=w9, body=w10, error out=w11)
    Unflatten From Json(JSON string=w10, type and defaults=T1 {all zero or empty}) -> (value=w12)
    Property Node(instance in=w12) -> ("S1max"=w13, "S1"=w14, "S3max"=w15, "S3"=w16, "PActive"=w17, "Tripped"=w18, "Trip1"=w19, "Trip2"=w20)
    Build Cluster(w13, 13000) -> w21
    $"Light on Sensor 1 Max_2" <- w21
    Build Cluster(w15, 13000) -> w22
    $"Light on Sensor 3 Max_2" <- w22
    $"SENSOR 1_2" <- w14
    $"SENSOR 3_2" <- w16
    $"PROTECTION ACTIVE_2" <- w17
    $TRIPPED_2 <- w18
    $"S1 LoS Max_2" <- w13
    $"S3 LoS Max_2" <- w15
    $"TRIP 1_2" <- w19
    $"TRIP 2_2" <- w20
    next s1 = w9
    next s2 = w11
    stop if FALSE
  }
  call "Close HTTP Handle.gvi"(client handle=s1, error in=s2)
