vi "index_2.gviweb"   [G Web Development Software 22.3.0]
panel controls:
  "Usuario": string
  "Contraseña": string
  "Confirm Button": bool
  "Logo3G_Image": string = "Image/LOGO%202024%20V3%20205X50.png"
  "LogoEecol_Image": string = "Image/EECOL%20LOGO%20156X50.png"
  "LogoLF_Image": string = "Image/LITELLFUSE%20201X50.png"
  "LogoPHOC_Image": string = "Image/PHOENIX%20CONTACT%20LOGO%20196X50.png"
  "Logo3G_Image_2": string = "Image/LOGO%202024%20V3%20205X50.png"
  "LogoEecol_Image_2": string = "Image/EECOL%20LOGO%20156X50.png"
  "LogoLF_Image_2": string = "Image/LITELLFUSE%20201X50.png"
  "LogoPHOC_Image_2": string = "Image/PHOENIX%20CONTACT%20LOGO%20196X50.png"
  "Logo3G_Image_3": string = "Image/LOGO%202024%20V3%20205X50.png"
  "LogoEecol_Image_3": string = "Image/EECOL%20LOGO%20156X50.png"
  "LogoLF_Image_3": string = "Image/LITELLFUSE%20201X50.png"
  "LogoPHOC_Image_3": string = "Image/PHOENIX%20CONTACT%20LOGO%20196X50.png"
  "Panel_Image_2": string = "Image/CDC%20ABB%2001%20450X290.png"
  "LogoEecol_Image_4": string = "Image/EECOL%20LOGO%20156X50.png"
  "SmartPhone": bool
  "LogoEecol_Image_5": string = "Image/EECOL%20LOGO%20156X50.png"
  "Tab_2": i32
  "Logo3G_Image_4": string = "Image/LOGO%202024%20V3%20205X50.png"
  "Logo3G_Image_5": string = "Image/LOGO%202024%20V3%20205X50.png"
panel indicators:
  "body": string
  "Tab": i32
  "Light on Sensor 1 Max": cluster{"Element 1": f64, "Element 2": f64}
  "SENSOR 1": bool
  "SENSOR 3": bool
  "TRIP 1": bool
  "TRIP 2": bool
  "PROTECTION ACTIVE": bool
  "TRIPPED": bool
  "Light on Sensor 3 Max": cluster{"Element 1": f64, "Element 2": f64}
  "S1 LoS Max": f64
  "S3 LoS Max": f64
  "S1 Lux Max": f64
  "S3 Lux Max": f64
  "URL Image": string
  "URL Image_2": string
  "URL Image_4": string
  "SENSOR 1_2": bool
  "SENSOR 3_2": bool
  "TRIP 1_2": bool
  "TRIP 2_2": bool
  "PROTECTION ACTIVE_2": bool
  "TRIPPED_2": bool
  "S1 LoS Max_2": f64
  "S3 LoS Max_2": f64
  "Light on Sensor 1 Max_2": cluster{"Element 1": f64, "Element 2": f64}
  "Light on Sensor 3 Max_2": cluster{"Element 1": f64, "Element 2": f64}
  "body_2": string
  "CDC_ABB": string
  "URL Image_3": string
  "URL Image_5": string
  "URL Image_6": string
  "URL Image_7": string
  "S2 LoS Max": f64
  "S4 LoS Max": f64
  "loop iteration": i32
  "loop iteration_2": i32
types:
  T1 = cluster{"S1max": f64, "S1": bool, "S3max": f64, "S3": bool, "PActive": bool, "Tripped": bool, "Trip1": bool, "Trip2": bool}
uses:
  NI::HTTP::Open HTTP Handle.gvi
  NI::HTTP::GET.gvi
  NI::HTTP::PUT Buffer.gvi
  NI::HTTP::Close HTTP Handle.gvi
diagram:
  disable {
    frame Enabled { }
    frame Disabled { }
  }
  sequence {
    frame 0 {
      Property Node(instance in=reference to "Usuario", "Value"="")
      Property Node(instance in=reference to "Contraseña", "Value"="")
      Property Node(instance in=reference to unnamed text, "Visible"=FALSE)
      $Tab <- 0
    }
  }
  call "Open HTTP Handle.gvi"(error in=no error) -> (client handle out=w1, error out=w2)
  s1 = w2  # shift register
  s2 = w1  # shift register
  while {
    Wait(time to wait=250)
    w3 = cluster{"user": string, "password": string} {all zero or empty}
    w4 = "https://arc-flash-relay-default-rtdb.firebaseio.com/access.json"
    call "GET.gvi"(client handle=s2, url=w4, error in=s1) -> (client handle out=w5, body=w6, error out=w7)
    Unflatten From Json(JSON string=w6, type and defaults=w3) -> (value=w8)
    case ($"Confirm Button") {
      frame False, Default {
        w9 = FALSE
        w10 = FALSE
      }
      frame True {
        Property Node(instance in=w8) -> ("user"=w11, "password"=w12)
        Is Equal(x=$Usuario, y=w11) -> w13
        Is Equal(x=w12, y=$Contraseña) -> w14
        Logical And(w13, w14) -> w9
        case (w9) {
          frame True {
            Property Node(instance in=reference to unnamed text, "Visible"=FALSE)
          }
          frame False {
            Property Node(instance in=reference to unnamed text, "Visible"=TRUE)
          }
        }
        w10 = $SmartPhone
      }
    }
    next s1 = w7
    next s2 = w5
    stop if w9
  }
  Obtain Queue(element data type=T1 {all zero or empty}, error in=s1, max queue size=10) -> (error out=w15, queue out=w16)
  s3 = s2  # shift register
  s4 = s1  # shift register
  s5 = w15  # shift register
  while (iteration -> i1) {
    disable {
      frame Enabled {
        w17 = s4
        w18 = s3
      }
      frame Disabled {
        w19 = "https://arc-flash-relay-default-rtdb.firebaseio.com/data-read.json"
        Property Node(instance in=cluster{"Reset": bool} {all zero or empty}) -> (instance out=w20)
        Flatten To Json(anything=w20) -> (JSON string=w21)
        call "PUT Buffer.gvi"(client handle=s3, url=w19, buffer=w21, error in=s4) -> (client handle out=w18, error out=w17)
        Wait(time to wait=100)
        Wait(time to wait=50)
      }
    }
    w22 = "https://arc-flash-relay-default-rtdb.firebaseio.com/data-send.json"
    call "GET.gvi"(client handle=w18, url=w22, error in=w17) -> (client handle out=w23, body=w24, error out=w25)
    $body <- w24
    $body_2 <- w24
    case (w10) {
      frame False, Default {
        w26 = 1
      }
      frame True {
        w26 = 2
      }
    }
    $Tab <- w26
    Unflatten From Json(JSON string=w24, type and defaults=T1 {all zero or empty}) -> (value=w27)
    Enqueue Element(element=w27, error in=s5, queue=w16, timeout in ms=1000) -> (error out=w28)
    $"loop iteration" <- i1
    next s3 = w23
    next s4 = w25
    next s5 = w28
    stop if FALSE
  }
  call "Close HTTP Handle.gvi"(client handle=s3, error in=s4)
  Release Queue(error in=s5, queue=w16)
  while (iteration -> i2) {
    Dequeue Element(queue=w16, timeout in ms=1000) -> (element=w29, error out=w30)
    case (w30) {
      frame Error, Default {
        w31 = TRUE
      }
      frame No Error {
        Property Node(instance in=w29) -> ("S1max"=w32, "S1"=w33, "S3max"=w34, "S3"=w35, "PActive"=w36, "Tripped"=w37, "Trip1"=w38, "Trip2"=w39)
        $"SENSOR 1" <- w33
        $"SENSOR 3" <- w35
        $"PROTECTION ACTIVE" <- w36
        $TRIPPED <- w37
        $"S1 Lux Max" <- w32
        $"S1 LoS Max" <- w32
        $"S3 Lux Max" <- w34
        $"S3 LoS Max" <- w34
        $"TRIP 1" <- w38
        $"TRIP 2" <- w39
        Build Cluster(w32, 13000) -> w40
        $"Light on Sensor 1 Max" <- w40
        Build Cluster(w34, 13000) -> w41
        $"Light on Sensor 3 Max" <- w41
        $"Light on Sensor 1 Max_2" <- w40
        $"Light on Sensor 3 Max_2" <- w41
        $"SENSOR 1_2" <- w33
        $"SENSOR 3_2" <- w35
        $"PROTECTION ACTIVE_2" <- w36
        $TRIPPED_2 <- w37
        $"S1 LoS Max_2" <- w32
        $"S3 LoS Max_2" <- w34
        $"TRIP 1_2" <- w38
        $"TRIP 2_2" <- w39
        w31 = FALSE
      }
    }
    $"loop iteration_2" <- i2
    stop if w31
  }
